% Simulink data dictionary plantDynamicsDictionary.sldd

v_init_ECEF = Simulink.Parameter([0; 0; 0], DataType="double")
Sig = Simulink.Signal()
x_init_ECEF = Simulink.Parameter([0; 0; 0], DataType="double")
MASS = Simulink.Parameter(2, DataType="double", Unit="kg")  % The mass of the vehicle.
q_body_NED_init = Simulink.Parameter([0; 0; 0; 1], DataType="double")  % Initial quaternion representing the orientation of the vehicle in the NED frame.
I_body_inverse = Simulink.Parameter([1 0 0; 0 1 0; 0 0 1], DataType="double")
I_body = Simulink.Parameter([1 0 0; 0 1 0; 0 0 1], DataType="double")
w_body_init = Simulink.Parameter([0; 0; 0], DataType="double")
h_body_int_init = Simulink.Parameter([0; 1; 0], DataType="double")